# Grasshopper definition metaballTable.gh (Grasshopper 1.0.7)
# plug-ins: Kangaroo2 Components, Heteroptera

number_slider = Slider(350, range=350..1000)  # disabled
number_slider_2 = Slider(800, range=350..1000)  # disabled
scale = Panel("0.1")  # disabled
pt = Point([Point(279, 218, 0), Point(-181, 218, 0), Point(49, -212, 0)])  # disabled
height = GetNumber(number_slider, AtLeast=1, AtMost=2147483647, Maximum=1.797693135e+308, Minimum=-1.797693135e+308)  # disabled
points = GetPoint(pt, AtLeast=1, AtMost=2147483647, Realtime=True)  # disabled
dimension = GetNumber(number_slider_2, AtLeast=1, AtMost=2147483647, Maximum=1.797693135e+308, Minimum=-1.797693135e+308)  # disabled
# COSTAS E ASSENTO
pt_2 = Point([Point(-276.455631, 163.4911105, 0), Point(-285.8299884, 106.3927518, 0), Point(-76.38284797, 50.27496492, 0), Point(-47.33829445, 44.19432296, 0), Point(-118.362602, -204.4080107, 0), Point(-19.84978102, -197.071809, 0), Point(-15.58870948, -64.12637679, 0)])
# BRAÇOS
pt_3 = Point([Point(-74.75427264, 52.01763765, 0), Point(154.4913765, 132.977997, 0), Point(163.8657339, 104.0027105, 0), Point(122.1072328, -20.42057862, 0), Point(164.7179482, -118.4252242, 0), Point(127.2205186, -148.252725, 0), Point(-25.32584271, -98.82429505, 0)])
number_slider_3 = Slider(2, range=0..10)
points2 = GetPoint(pt_2, AtLeast=1, AtMost=2147483647, Realtime=True)
dom = ConstructDomain(DomainStart=expr("-x/2", dimension), DomainEnd=expr("x/2", dimension))  # disabled
list_item = ListItem(List=pt_3, Index=0, Wrap=True)
deconstruct = Deconstruct(Point=points2)  # -> XComponent, YComponent, ZComponent
points_2 = GetPoint(pt_3, AtLeast=1, AtMost=2147483647, Realtime=True)
Z = UnitZ(Factor=height)  # disabled
panel = Panel(points_2)
rectangle = Rectangle(Plane=PlaneXY(0, 0, 0), XSize=dom, YSize=dom, Radius=0)  # -> Rectangle, Length; disabled
interpolate = Interpolate(Vertices=points_2, Degree=3, Periodic=False, KnotStyle=1)  # -> Curve, Length, Domain
interpolate_2 = Interpolate(Vertices=points2, Degree=3, Periodic=False, KnotStyle=1)  # -> Curve, Length, Domain
interpolate_3 = Interpolate(Vertices=points, Degree=3, Periodic=False, KnotStyle=1)  # -> Curve, Length, Domain; disabled
panel_2 = Panel(deconstruct.XComponent)
panel_3 = Panel(deconstruct.YComponent)
deconstruct_2 = Deconstruct(Point=points_2)  # -> XComponent, YComponent, ZComponent
move = Move(Geometry=rectangle.Rectangle, Motion=Z)  # -> Geometry, Transform; disabled
number_slider_4 = Slider(100, range=0..100)  # disabled
c_script = CSharpScript(crv=interpolate.Curve, color=ColourSwatch(SwatchColor=RGBA(244, 250, 160, 177)))  # -> out, A; inputs crv: Curve, color: Color
# ---------- c_script: C# ----------
    var c = color.R + "," + color.G + "," + color.B;
    crv.SetUserString("color", c);
    A = crv;
# ---------- end c_script ----------

# ---- group: RH_OUT:limit
crv = Curve(rectangle.Rectangle)  # disabled

# ----
c_script_2 = CSharpScript(crv=interpolate_2.Curve, color=ColourSwatch(SwatchColor=RGBA(255, 208, 79, 182)))  # -> out, A; inputs crv: Curve, color: Color; same code as c_script
unit_z = UnitZ(Factor=number_slider_4)  # disabled
move_2 = Move(Geometry=interpolate_3.Curve, Motion=unit_z)  # -> Geometry, Transform; disabled
scale_2 = Scale(Geometry=points, Center=Point(0, 0, 0), Factor=scale)  # -> Geometry, Transform; disabled
scale_3 = Scale(Geometry=move.Geometry, Center=Point(0, 0, 0), Factor=scale)  # -> Geometry, Transform; disabled
panel_4 = Panel("10")  # disabled
panel_5 = Panel(deconstruct_2.XComponent)
panel_6 = Panel(deconstruct_2.YComponent)

# ---- group: RH_OUT:curve
curve = Curve(reparameterize(c_script.A))

# ---- group: RH_OUT:curve2
curve_2 = Curve(reparameterize(c_script_2.A))

# ----
pop2d = Populate2D(Region=scale_3.Geometry, Count=panel_4, Seed=1)  # disabled

# ---- group: RH_OUT:spline
curve_3 = Curve(move_2.Geometry)  # disabled

# ----
item = ListItem(List=pop2d, Index=0, Wrap=True)  # disabled
cp = ClosestPoint(Point=scale_2.Geometry, Cloud=pop2d)  # -> ClosestPoint, CPIndex, Distance; disabled
number_slider_5 = Slider(17, range=5..25)  # disabled
dimension_2 = GetNumber(Slider(10, range=0..10), AtLeast=1, AtMost=2147483647, Maximum=1.797693135e+308, Minimum=-1.797693135e+308)
construct_domain = Domain(DomainStart=expr("-x/2", dimension_2), DomainEnd=expr("x/2", dimension_2))
construct_domain_2 = Domain(DomainStart=expr("-x/2", dimension_2), DomainEnd=expr("x/2", dimension_2))
pdecon = Deconstruct(Point=item)  # -> XComponent, YComponent, ZComponent; disabled
construct_domain_3 = Domain(DomainStart=expr("-x/2", dimension_2), DomainEnd=expr("x/2", dimension_2))
construct_domain_4 = Domain(DomainStart=expr("-x/2", dimension_2), DomainEnd=expr("x/2", dimension_2))
ln = Line(StartPoint=cp.ClosestPoint, EndPoint=scale_2.Geometry)  # disabled
panel_7 = Panel("0")  # disabled
panel_8 = Panel("10")  # disabled
range = Range(Domain=pdecon.ZComponent, Steps=number_slider_5)  # disabled
ext = ExtendCurve(Curve=ln, Type=0, Start=panel_7, End=panel_8)  # disabled
rectangle_2 = Rectangle(Plane=PlaneXY(0, 0, 0), XSize=construct_domain, YSize=construct_domain_2, Radius=0)  # -> Rectangle, Length
rectangle_3 = Rectangle(Plane=PlaneXY(0, 0, 0), XSize=construct_domain_4, YSize=construct_domain_3, Radius=0)  # -> Rectangle, Length
item_2 = ListItem(List=reverse(range), Index=0, Wrap=True)  # disabled
number_slider_6 = Slider(39.123, range=0..100)  # disabled
number_slider_7 = Slider(2.212, range=0..100)  # disabled
divide = DivideCurve(Curve=ext, Count=10, Kinks=False)  # -> flatten(Points), Tangents, Parameters; disabled
perp_frame = PerpFrame(Curve=curve_2, Parameter=Slider(1, range=0..1))
perp_frame_2 = PerpFrame(Curve=curve, Parameter=Slider(1, range=0..1))
xy_plane = XYPlane(Origin=Point(0, 0, 0))
xy_plane_2 = XYPlane(Origin=Point(0, 0, 0))
lng = ListLength(List=divide.Points)  # disabled
orient = Orient(Geometry=rectangle_2.Rectangle, Source=xy_plane, Target=perp_frame)  # -> Geometry, Transform
orient_2 = Orient(Geometry=rectangle_3.Rectangle, Source=xy_plane_2, Target=perp_frame_2)  # -> Geometry, Transform
dup = DuplicateData(Data=number_slider_6, Number=panel_4, Order=True)  # disabled
dup_2 = DuplicateData(Data=number_slider_7, Number=lng, Order=True)  # disabled
pt_4 = ConstructPoint(XCoordinate=0, YCoordinate=0, ZCoordinate=range)  # disabled
bool = Boolean(lng)  # disabled
sweep1 = Sweep1(Rail=curve_2, Sections=orient.Geometry, Miter=1)
number_slider_8 = Slider(0.506, range=0..1)  # disabled
sweep1_2 = Sweep1(Rail=curve, Sections=orient_2.Geometry, Miter=1)
merge = Merge(Data1=flatten(divide.Points), Data2=flatten(pop2d))  # disabled
center = Center(Geometric=sweep1)  # -> Center, Dimension
center_2 = Center(Geometric=sweep1_2)  # -> Center, Dimension
merge_2 = Merge(Data1=dup_2, Data2=dup)  # disabled
negative = Negative(Value=Slider(90, range=0..360))
filter = StreamFilter(Gate=bool, Stream1=merge_2)  # disabled
xz_plane = XZPlane(Origin=Point(0, 0, 0))
rotate_3d = Rotate3D(Geometry=sweep1_2, Angle=degrees(negative), Center="0,0,0", Axis=xz_plane)  # -> Geometry, Transform
xz_plane_2 = XZPlane(Origin=Point(0, 0, 0))
rotate_3d_2 = Rotate3D(Geometry=sweep1, Angle=degrees(negative), Center="0,0,0", Axis=xz_plane_2)  # -> Geometry, Transform
panel_9 = Panel("10")  # disabled
number_slider_9 = Slider(15, range=1..15)
metaball_t = MetaBallTCustom(Points=merge, Charge=filter, Plane=pt_4, Threshold=number_slider_8)  # disabled
scale_4 = Scale(Geometry=metaball_t, Center=Point(0, 0, 0), Factor=panel_9)  # -> Geometry, Transform; disabled
height_2 = GetNumber(Slider(196, range=0..1000), AtLeast=1, AtMost=2147483647, Maximum=1.797693135e+308, Minimum=-1.797693135e+308)
unit_x = UnitX(Factor=height_2)
move_3 = Move(Geometry=rotate_3d.Geometry, Motion=unit_x)  # -> Geometry, Transform
crv_2 = Curve(simplify(scale_4.Geometry))  # disabled
division = Division(A=height_2, B=dimension_2)
series = Series(Start=Slider(0, range=0..10), Step=dimension_2, Count=division)
unit_x_2 = UnitX(Factor=series)
move_4 = Move(Geometry=rotate_3d_2.Geometry, Motion=unit_x_2)  # -> Geometry, Transform
point = Point(Point(-894.1726251, 0.6635282794, 0))
explode = Explode(Curve=crv_2, Recursive=True)  # -> flatten(Segments), Vertices; disabled
vector_2pt = Vector2Pt(PointA=center_2.Center, PointB=point, Unitize=False)  # -> Vector, Length
vector_2pt_2 = Vector2Pt(PointA=center_2.Center, PointB=point, Unitize=False)  # -> Vector, Length
dupln = RemoveDuplicateLines(Lines=explode.Segments, Tolerance=0.01)  # disabled
move_5 = Move(Geometry=[move_3.Geometry, rotate_3d.Geometry], Motion=vector_2pt.Vector)  # -> Geometry, Transform
join = JoinCurves(Curves=dupln, Preserve=False)  # disabled
list_length = ListLength(List=move_4.Geometry)
list_item_2 = ListItem(List=move_4.Geometry, Index=0, Wrap=True)
move_6 = Move(Geometry=move_4.Geometry, Motion=vector_2pt_2.Vector)  # -> Geometry, Transform
point_2 = Point(Point(-7.377182708, 902.1359661, 0))
number_slider_10 = Slider(767, range=0..1000)
number_slider_11 = Slider(767, range=0..1000)
list_length_2 = ListLength(List=move_5.Geometry)
list_item_3 = ListItem(List=move_3.Geometry, Index=0, Wrap=True)
get_string = GetString(list_length, AtLeast=1, AtMost=2147483647)
redpline = Reduce(Polyline=join, Tolerance=1)  # -> Polyline, Reduction; disabled
center_3 = Center(Geometric=list_item_2)  # -> Center, Dimension
point_3 = Point(Point(302.1809779, 903.4481303, 0))
center_4 = Center(Geometric=list_item_3)  # -> Center, Dimension
deconstruct_brep = DeconstructBrep(Brep=move_5.Geometry)  # -> Faces, flatten(Edges), Vertices
point_4 = Point(Point(-7.377182708, 902.1359661, 0))
midpt = CurveMiddle(Curve=redpline.Polyline)  # disabled
get_string_2 = GetString(list_length_2, AtLeast=1, AtMost=2147483647)
deconstruct_brep_2 = DeconstructBrep(Brep=move_6.Geometry)  # -> Faces, flatten(Edges), Vertices
c_script_3 = CSharpScript(face="Verdana", size=Slider(26, range=0..100), content=get_string, pl=point_3)  # -> out, A; inputs face: String, bold: Boolean, italics: Boolean, size: Double, content: String, pl: Plane
# ---------- c_script_3: C# usings ----------
using System.IO;
using System.Linq;
using System.Data;
using System.Drawing;
using System.Reflection;
using System.Windows.Forms;
using System.Xml;
using System.Xml.Linq;
using System.Runtime.InteropServices;

using Rhino.DocObjects;
using Rhino.Collections;
using GH_IO;
using GH_IO.Serialization;
# ---------- c_script_3: C# ----------
    if(size == 0)
      size = 1;

    if(!string.IsNullOrEmpty(face) && size > 0 && !string.IsNullOrEmpty(content) &&
      pl.IsValid)
    {
      using (var doc = Rhino.RhinoDoc.CreateHeadless(null))
      {
        var te = doc.Objects.AddText(content, pl, size, face, bold, italics);
        var txt = doc.Objects.Find(te) as Rhino.DocObjects.TextObject;

        if(txt != null)
        {
          var tt = txt.Geometry as Rhino.Geometry.TextEntity;
          A = tt.Explode();
        }
      }
    }
# ---------- end c_script_3 ----------
point_5 = Point(Point(-585.4527926, 903.4481303, 0))
dom_2 = Domain(DomainStart=expr("-x/2", number_slider_11), DomainEnd=expr("x/2", number_slider_11))
dom_3 = Domain(DomainStart=expr("-x/2", number_slider_11), DomainEnd=expr("x/2", number_slider_11))
dom_4 = Domain(DomainStart=expr("-x/2", number_slider_10), DomainEnd=expr("x/2", number_slider_10))
dom_5 = Domain(DomainStart=expr("-x/2", number_slider_10), DomainEnd=expr("x/2", number_slider_10))
yz_plane = YZPlane(Origin=center_3.Center)
pdecon_2 = Deconstruct(Point=midpt)  # -> XComponent, YComponent, ZComponent; disabled
yz_plane_2 = YZPlane(Origin=center_4.Center)
c_script_4 = CSharpScript(face="Verdana", size=Slider(26, range=0..100), content=get_string_2, pl=point_5)  # -> out, A; inputs face: String, bold: Boolean, italics: Boolean, size: Double, content: String, pl: Plane; same code as c_script_3
rotate = Rotate(Geometry=c_script_3.A, Angle=degrees(90), Plane=point_3)  # -> Geometry, Transform
bnd = Bounds(Numbers=pdecon_2.ZComponent)  # disabled
rectangle_4 = Rectangle(Plane=point, XSize=dom_2, YSize=dom_3, Radius=0)  # -> Rectangle, Length
rectangle_5 = Rectangle(Plane=PlaneXY(0, 0, 0), XSize=dom_4, YSize=dom_5, Radius=0)  # -> Rectangle, Length
orient_3 = Orient(Geometry=list_item_2, Source=yz_plane, Target=point_4)  # -> Geometry, Transform
rotate_2 = Rotate(Geometry=c_script_4.A, Angle=degrees(90), Plane=point_5)  # -> Geometry, Transform
mesh = Mesh(move_5.Geometry)
mesh_2 = Mesh(move_6.Geometry)
dedomain = DeconstructDomain(Domain=bnd)  # -> Start, End; disabled
c_script_5 = CSharpScript(crv=rotate.Geometry, color=ColourSwatch(SwatchColor=RGB(255, 255, 255)))  # -> out, A; inputs crv: Curve, color: Color; same code as c_script
bounding_box = BoundingBox(Content=orient_3.Geometry, Plane=PlaneXY(0, 0, 0))  # -> Box, Box_2
gradient = Gradient(
    LowerLimit=0,
    UpperLimit=dedomain.End,
    Parameter=pdecon_2.ZComponent,
    stops=[0.125: RGB(0, 0, 0), 0.499: RGB(255, 251, 0), 0.868: RGB(255, 0, 255)])  # disabled
c_script_6 = CSharpScript(mesh=mesh)  # -> base64Draco; inputs mesh: Mesh
# ---------- c_script_6: C# ----------
    var options = new Rhino.FileIO.DracoCompressionOptions();
    options.CompressionLevel = 5;
    options.IncludeTextureCoordinates = false;
    options.IncludeVertexColors = false;

    var compressed = Rhino.FileIO.DracoCompression.Compress(mesh, options);
    base64Draco = compressed.ToBase64String();
# ---------- end c_script_6 ----------
c_script_7 = CSharpScript(mesh=mesh_2)  # -> base64Draco; inputs mesh: Mesh; same code as c_script_6
deconstruct_brep_3 = DeconstructBrep(Brep=bounding_box.Box)  # -> Faces, Edges, Vertices

# ---- group: RH_OUT:pieces1
crv_3 = Curve(c_script_5.A)

# ----
c_script_8 = CSharpScript(crv=rotate_2.Geometry, color=ColourSwatch(SwatchColor=RGB(255, 255, 255)))  # -> out, A; inputs crv: Curve, color: Color; same code as c_script
c_script_9 = CSharpScript(crv=[deconstruct_brep_2.Edges, deconstruct_brep.Edges], color=ColourSwatch(SwatchColor=RGB(255, 255, 255)))  # -> out, A; inputs crv: Curve, color: Color; same code as c_script

# ---- group: RH_OUT:Mesh2
txt = Text(c_script_6)

# ---- group: RH_OUT:Mesh
txt_2 = Text(c_script_7)

# ----
unit_x_3 = UnitX(Factor=Slider(896, range=0..1000))
list_item_4 = ListItem(List=deconstruct_brep_3.Edges, Index=0, Wrap=True)  # -> Item, Item1

# ---- group: RH_OUT:pieces2
crv_4 = Curve(c_script_8.A)

# ----
c_script_10 = CSharpScript(crv=redpline.Polyline, color=gradient)  # -> out, A; inputs crv: Curve, color: Color; disabled; same code as c_script

# ---- group: RH_OUT:edges2
curve_4 = Curve(c_script_9.A)

# ----
move_7 = Move(Geometry=point_2, Motion=expr("-x", unit_x_3))  # -> Geometry, Transform
orient_4 = Orient(Geometry=list_item_3, Source=yz_plane_2, Target=move_7.Geometry)  # -> Geometry, Transform
bounding_box_2 = BoundingBox(Content=orient_4.Geometry, Plane=PlaneXY(0, 0, 0))  # -> Box, Box_2
deconstruct_brep_4 = DeconstructBrep(Brep=orient_4.Geometry)  # -> Faces, Edges, Vertices
deconstruct_brep_5 = DeconstructBrep(Brep=bounding_box_2.Box)  # -> Faces, Edges, Vertices
list_item_5 = ListItem(List=deconstruct_brep_5.Edges, Index=0, Wrap=True)  # -> Item, Item1
deconstruct_brep_6 = DeconstructBrep(Brep=orient_3.Geometry)  # -> Faces, Edges, Vertices
list_item_6 = ListItem(List=deconstruct_brep_4.Faces, Index=Slider(1, range=0..10), Wrap=True)
preview = CustomPreview(Geometry=redpline.Polyline, Material=gradient)  # disabled
point_on_curve = PointOnCurve(list_item_4.Item1, parameter=0.5)
length = Length(Curve=list_item_4.Item1)
length_2 = Length(Curve=list_item_4.Item)
point_on_curve_2 = PointOnCurve(list_item_4.Item, parameter=0.5)
point_on_curve_3 = PointOnCurve(list_item_5.Item1, parameter=0.5)

# ---- group: RH_OUT:crvs
crv_5 = Curve(c_script_10.A)  # disabled

# ----
point_on_curve_4 = PointOnCurve(list_item_5.Item, parameter=0.5)
length_3 = Length(Curve=list_item_5.Item1)
explode_2 = Explode(Curve=list_item_6, Recursive=True)  # -> Segments, Vertices
length_4 = Length(Curve=list_item_5.Item)
round = Round(Number=length)  # -> Nearest, Floor, Ceiling
round_2 = Round(Number=length_2)  # -> Nearest, Floor, Ceiling
list_item_7 = ListItem(List=deconstruct_brep_6.Faces, Index=Slider(1, range=0..10), Wrap=True)
number_slider_12 = Slider(767, range=0..1000)
round_3 = Round(Number=length_3)  # -> Nearest, Floor, Ceiling
round_4 = Round(Number=length_4)  # -> Nearest, Floor, Ceiling
get_string_3 = GetString(round.Nearest, AtLeast=1, AtMost=2147483647)
get_string_4 = GetString(round_2.Nearest, AtLeast=1, AtMost=2147483647)
explode_3 = Explode(Curve=list_item_7, Recursive=True)  # -> Segments, Vertices
number_slider_13 = Slider(767, range=0..1000)
c_script_11 = CSharpScript(crv=explode_2.Segments, color=ColourSwatch(SwatchColor=RGB(255, 255, 255)))  # -> out, A; inputs crv: Curve, color: Color; same code as c_script
curve_5 = Curve(list_item_5.Item)
c_script_12 = CSharpScript(face="Verdana", size=Slider(16, range=0..100), content=get_string_3, pl=point_on_curve)  # -> out, A; inputs face: String, bold: Boolean, italics: Boolean, size: Double, content: String, pl: Plane; same code as c_script_3
dom_6 = Domain(DomainStart=expr("-x/2", number_slider_12), DomainEnd=expr("x/2", number_slider_12))
dom_7 = Domain(DomainStart=expr("-x/2", number_slider_12), DomainEnd=expr("x/2", number_slider_12))
c_script_13 = CSharpScript(face="Verdana", size=Slider(16, range=0..100), content=get_string_4, pl=point_on_curve_2)  # -> out, A; inputs face: String, bold: Boolean, italics: Boolean, size: Double, content: String, pl: Plane; same code as c_script_3
get_string_5 = GetString(round_3.Nearest, AtLeast=1, AtMost=2147483647)
get_string_6 = GetString(round_4.Nearest, AtLeast=1, AtMost=2147483647)
rotate_3 = Rotate(Geometry=c_script_12.A, Angle=degrees(90), Plane=point_on_curve)  # -> Geometry, Transform
c_script_14 = CSharpScript(crv=rotate_3.Geometry, color=ColourSwatch(SwatchColor=RGB(255, 255, 255)))  # -> out, A; inputs crv: Curve, color: Color; same code as c_script
c_script_15 = CSharpScript(crv=c_script_13.A, color=ColourSwatch(SwatchColor=RGB(255, 255, 255)))  # -> out, A; inputs crv: Curve, color: Color; same code as c_script
rectangle_6 = Rectangle(Plane=move_7.Geometry, XSize=dom_6, YSize=dom_7, Radius=0)  # -> Rectangle, Length
dom_8 = Domain(DomainStart=expr("-x/2", number_slider_13), DomainEnd=expr("x/2", number_slider_13))
dom_9 = Domain(DomainStart=expr("-x/2", number_slider_13), DomainEnd=expr("x/2", number_slider_13))
c_script_16 = CSharpScript(crv=explode_3.Segments, color=ColourSwatch(SwatchColor=RGB(255, 255, 255)))  # -> out, A; inputs crv: Curve, color: Color; same code as c_script
c_script_17 = CSharpScript(face="Verdana", size=Slider(16, range=0..100), content=get_string_5, pl=point_on_curve_3)  # -> out, A; inputs face: String, bold: Boolean, italics: Boolean, size: Double, content: String, pl: Plane; same code as c_script_3
c_script_18 = CSharpScript(face="Verdana", size=Slider(16, range=0..100), content=get_string_6, pl=point_on_curve_4)  # -> out, A; inputs face: String, bold: Boolean, italics: Boolean, size: Double, content: String, pl: Plane; same code as c_script_3

# ---- group: RH_OUT:text_lines
crv_6 = Curve(c_script_15.A)

# ----
rectangle_7 = Rectangle(Plane=point_4, XSize=dom_8, YSize=dom_9, Radius=0)  # -> Rectangle, Length
c_script_19 = CSharpScript(crv=c_script_18.A, color=ColourSwatch(SwatchColor=RGB(255, 255, 255)))  # -> out, A; inputs crv: Curve, color: Color; same code as c_script

# ---- group: RH_OUT:plan
curve_6 = Curve(c_script_16.A)

# ---- group: RH_OUT:textlines2
crv_7 = Curve(c_script_14.A)

# ----
rotate_4 = Rotate(Geometry=c_script_17.A, Angle=degrees(90), Plane=point_on_curve_3)  # -> Geometry, Transform
c_script_20 = CSharpScript(crv=rotate_4.Geometry, color=ColourSwatch(SwatchColor=RGB(255, 255, 255)))  # -> out, A; inputs crv: Curve, color: Color; same code as c_script

# ---- group: RH_OUT:textlines4
crv_8 = Curve(c_script_19.A)

# ---- group: RH_OUT:textlines3
crv_9 = Curve(c_script_20.A)

# ----
number_slider_14 = Slider(21, range=0..100)
curve_7 = Curve(list_item_5.Item1)
unit_y = UnitY(Factor=number_slider_14)
unit_x_4 = UnitX(Factor=number_slider_14)
curve_8 = Curve(list_item_4.Item1)
unit_y_2 = UnitY(Factor=number_slider_14)
unit_x_5 = UnitX(Factor=number_slider_14)
c_script_21 = CSharpScript(
    crv=[rectangle_4.Rectangle, rectangle_5.Rectangle, rectangle_7.Rectangle, rectangle_6.Rectangle],
    color=ColourSwatch(SwatchColor=RGB(255, 255, 255)))  # -> out, A; inputs crv: Curve, color: Color; same code as c_script
curve_9 = Curve(list_item_4.Item)
move_8 = Move(Geometry=curve_5, Motion=expr("-x", unit_y))  # -> flatten(Geometry), Transform
move_9 = Move(Geometry=curve_7, Motion=unit_x_4)  # -> flatten(Geometry), Transform
move_10 = Move(Geometry=curve_8, Motion=unit_x_5)  # -> flatten(Geometry), Transform
move_11 = Move(Geometry=curve_9, Motion=expr("-x", unit_y_2))  # -> flatten(Geometry), Transform

# ---- group: RH_OUT:limit
crv_10 = Curve(c_script_21.A)

# ----
c_script_22 = CSharpScript(crv=move_8.Geometry, color=ColourSwatch(SwatchColor=RGB(255, 255, 255)))  # -> out, A; inputs crv: Curve, color: Color; same code as c_script
c_script_23 = CSharpScript(crv=move_9.Geometry, color=ColourSwatch(SwatchColor=RGB(255, 255, 255)))  # -> out, A; inputs crv: Curve, color: Color; same code as c_script
c_script_24 = CSharpScript(crv=move_10.Geometry, color=ColourSwatch(SwatchColor=RGB(255, 255, 255)))  # -> out, A; inputs crv: Curve, color: Color; same code as c_script
c_script_25 = CSharpScript(crv=move_11.Geometry, color=ColourSwatch(SwatchColor=RGB(255, 255, 255)))  # -> out, A; inputs crv: Curve, color: Color; same code as c_script

# ---- group: RH_OUT:x3
curve_10 = Curve(c_script_11.A)

# ---- group: RH_OUT:x2
curve_11 = Curve(c_script_23.A)

# ---- group: RH_OUT:x
curve_12 = Curve(c_script_22.A)

# ---- group: RH_OUT:dim2
curve_13 = Curve(c_script_24.A)

# ---- group: RH_OUT:dim1
curve_14 = Curve(c_script_25.A)
